# Grasshopper definition 02_voronoiExtrusions_hops.gh (Grasshopper 1.0.7)
# plug-ins: Weaverbird

# ----
# Max height
number_slider = Slider(5.17, range=-5..10)

# ----
# Rectangle size
number_slider_2 = Slider(27, range=0..100)

# ----
# Top opening size
number_slider_3 = Slider(0.4, range=0..1)

# ----
# Number of voronoi
number_slider_4 = Slider(50, range=0..1000)

# ----
# Randomness
number_slider_5 = Slider(0, range=0..100)

seed = GetInteger(number_slider_5, AtLeast=1, AtMost=1, Maximum=2147483647, Minimum=-2147483648)
opening = GetNumber(number_slider_3, AtLeast=1, AtMost=1, Maximum=1.797693135e+308, Minimum=-1.797693135e+308)
number = GetInteger(number_slider_4, AtLeast=1, AtMost=1, Maximum=2147483647, Minimum=-2147483648)
width = GetInteger(Slider(22, range=0..100), AtLeast=1, AtMost=1, Maximum=2147483647, Minimum=-2147483648)
length = GetInteger(number_slider_2, AtLeast=1, AtMost=1, Maximum=2147483647, Minimum=-2147483648)
height = GetNumber(number_slider, AtLeast=1, AtMost=1, Maximum=1.797693135e+308, Minimum=-1.797693135e+308)
rectangle = Rectangle(Plane=PlaneXY(0, 0, 0), XSize=width, YSize=length, Radius=0)  # -> Rectangle, Length
pop2d = Populate2D(Region=rectangle.Rectangle, Count=number, Seed=1)
lng = ListLength(List=pop2d)
voronoi = Voronoi(Points=pop2d, Boundary=rectangle.Rectangle, BruteForceOverride=False)
dom = ConstructDomain(DomainStart=0, DomainEnd=height)
random = Random(Range=dom, Number=lng, Seed=seed)
scale = Scale(Geometry=voronoi, Center=pop2d, Factor=opening)  # -> Geometry, Transform
Z = UnitZ(Factor=random)  # -> flatten(UnitVector)
move = Move(Geometry=scale.Geometry, Motion=Z)  # -> Geometry, Transform
rulesrf = RuledSurface(CurveA=voronoi, CurveB=move.Geometry)
rulesrf_2 = RuledSurface(CurveA=scale.Geometry, CurveB=move.Geometry)
join = BrepJoin(Breps=[rulesrf, rulesrf_2])  # -> Breps, Closed
qrmesh = QuadRemesh(Mesh=join.Breps, Settings={aqc=True, as=50, dhe=True, gci=0, null=False, pme=0, sa=0, tqc=2000})
wbjoin = WeaverbirdsJoinMeshesAndWeld(Mesh=qrmesh, Weld=False)
wbcatmullclark = WeaverbirdsCatmullClarkSubdivision(MeshCurves=wbjoin, Level=1, SmoothNakedEdges=1)
context_bake = ContextBake(SimpleBrep=join.Breps)
context_bake_2 = ContextBake(Geometry=wbcatmullclark)
